# Grasshopper definition 221025_Intro_dict_json.gh (Grasshopper 1.0.7)

# ---- group: BASICS DICTIONARY
python = GhPythonScript()  # -> out, a, export_d
# ---------- python: Python ----------
"""
MasDfab 22-23

Python Dictionaries.
Dictionaries are used to store data values in   key:value   pairs.

"""

# initialize a dictionary (use curly brackets)
my_dictionary = {}
# or
my_dictionary = dict()

# check the type
print (type(my_dictionary))

# create a new dictionary with keys and empty lists as a value
my_d =   { "students": [] ,
            "robots": [] ,
            "chairs": [] }
#print my_d


# add a new pair of key:value to a dictionary
# "laptops" is key, True is value
# the values in dicts can be any data type: str, boolean, int, etc.
my_d["laptops"] = True
#print my_d


# if you add a new pair of key:value that already exsists, it will update it with a new value
# because dicts do not allow two values with the same key
my_d["robots"] = True, "abb", 5
my_d["students"] = "XX","YY","ZZ"
#print my_d


# delete a key from a dictionary
del my_d["chairs"]

# remove the key and return the value
print my_d.pop("robots")

print ("final version of my dictionary after changes: its length: {}, its keys: {}, its values: {}".format(len(my_d),my_d.keys(),my_d.values()))

# iterate through the dictionary through the pairs
for key,value in my_d.items():
    print key,value

# iterate through the keys
for key in my_d.keys():
    print key

# iterate through the values
for value in my_d.values():
    print value

# "A dictionary that is passed as output from a component will be seen as enumerable and will be enumerated" (c)
# which means that only the keys will be resolved
a = my_d


# you can hide it in the class if you want pass the data
class D_data:
    pass

export_d = D_data()
export_d.my_d = my_d
# ---------- end python ----------
panel = Panel(python.a)
panel_2 = Panel(python.export_d)
python_2 = GhPythonScript(import_d=python.export_d)
# ---------- python_2: Python ----------
a = import_d.my_d
print a
print type(import_d.my_d)
# ---------- end python_2 ----------

# ---- group: BASICS JSON
python_3 = GhPythonScript()  # -> a, spheres, my_d
# ---------- python_3: Python ----------
"""
MasDfab 22-23

JSON stands for JavaScript Object Notation
JSON is a lightweight data-interchange format
JSON is plain text written in JavaScript object notation
JSON is used to send data between computers

https://realpython.com/python-json/

"""
import os
import Rhino.Geometry as rg

# to work with json files import the python module json
import json

# in python json files are represented as a string
my_json = '{"student": "Paul", "laptop": "Lenovo", "Tag": ["github", "hiking"]}'
print type(my_json)



########## ===================== JSON is the string representation of the data ================== ##############
# ======= DICTIONARIES are the actual data structures in memory that are created when the program runs ======= #


# 1.0 # how to parse a json string ?
my_json_d = json.loads(my_json)
print type(my_json_d)


# 2.0 #  how to parse a json file ?
# 2.1 #  get the file name (gh_canvas) and get the folder directory (folder)
gh_canvas = ghenv.Component.OnPingDocument()
folder = os.path.dirname(gh_canvas.FilePath)


# 2.3 # "with open()" allows for opening and closing the file after the block inside of statement is exited.
with open(os.path.join(folder,'simple_spheres.json')) as file:
    
    # 2.4 # json.load() converts json string to dictionary 
    my_d = json.load(file)


spheres = []

rr = my_d['radius']
xx = my_d['originX']
yy = my_d['originY']
zz = my_d['originZ']

for r,x,y,z in zip(rr,xx,yy,zz):
    s = rg.Sphere(rg.Point3d(x,y,z), r)
    spheres.append(s)


# 3.0 # how to write a json file?
# 3.1 # create a random dictionary my_d2
my_d2 = {"module": ["mola", "axolotl", "grasshopper"], "robots" : ["abb", "ur5", "ur10"], "numbers": [1,2,3,4,5]}


# 3.2 # 'w' - stands for 'write' - is a specification of the mode when opening the file, it will open a file for writing or create a new one if it does not exist.
with open(os.path.join(folder,'my_first_jfile.json'), 'w') as file:
    
    # 3.3 #  use the method json.dump() - it converts dictionary to a json string
    my_j = json.dump(my_d2, file, indent = 2)
# ---------- end python_3 ----------
panel_3 = Panel(python_3.my_d)
brep = Brep(python_3.spheres)

# ---- group: BASIC GEO + COMPAS + JSON / LOAD JSON FILE
python_4 = GhPythonScript(load=Button())  # -> my_d, a
# ---------- python_4: Python ----------
import os
import sys
import compas

canvas = ghenv.Component.OnPingDocument()
folder = os.path.dirname(canvas.FilePath)

if load:
    my_d = compas.json_load(os.path.join(folder, 'simple_bricks.json'))
    a = my_d["boxes"]
# ---------- end python_4 ----------

# ---- group: BASIC GEO + COMPAS + JSON
crv = Curve(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)
python_5 = GhPythonScript(
    crv=crv,
    count=Slider(47, range=0..100),
    length=Slider(9.6, range=0..10),
    width=Slider(4.7, range=0..10),
    height=Slider(4.1, range=0..10),
    save=Button())  # -> out, origin_frames, pick_frames, bricks; inputs crv: Curve, length: Int32, width: Int32, height: Int32, save: Boolean
# ---------- python_5: Python ----------
"""
MasDfab 22-23

Example of basic compas geometry and json 

"""

import os
import sys
import Rhino.Geometry as rg
import compas

from compas_rhino import conversions as c
from compas.geometry import Frame, Vector, Box
from compas.geometry import Translation

# get the gh_file name(gh_canvas) and folder directory(folder) where we will store the file
gh_canvas = ghenv.Component.OnPingDocument()
folder = os.path.dirname(gh_canvas.FilePath)

# dividing the curve by count, return the curve params
params = crv.DivideByCount(count,True)
planes = []


for i in params:
    
    p = crv.PointAt(i)
    t = crv.TangentAt(i)
    
    v = rg.Vector3d.CrossProduct(t, rg.Vector3d(0,0,1))
    
    p =  rg.Plane(p,t,v)

    planes.append(p)



# using compas in-built method to transform rhino planes into compas frames
origin_frames = [c.plane_to_compas_frame(p) for p in planes]

# define translation 
T = Translation.from_vector(Vector(0,0,height/2))

# apply translation to origin frames
pick_frames = [f.transformed(T) for f in origin_frames]

# create a compas mesh (Box)
bricks = [ Box(f,length,width,height) for f in origin_frames]

# creating a dictionary and exporting the json file 
if save:
    compas.json_dump({"p_frames":[ p for p in pick_frames], "boxes": [ b for b in bricks]}, 
                    os.path.join(folder, 'simple_bricks.json'),
                    pretty = True)
# ---------- end python_5 ----------
draw = Draw(cg=python_4.a)  # -> rg
#   port cg: The COMPAS geometry or datastructure to be drawn.
#   port rg: The Rhino geometry object.
# ---------- draw: Python ----------
"""
Draws COMPAS geometry in Grasshopper.
"""
from ghpythonlib.componentbase import executingcomponent as component

from compas.artists import Artist


class CompasToRhinoGeometry(component):
    def RunScript(self, cg):
        if not cg:
            return None

        return Artist(cg).draw()
# ---------- end draw ----------
panel_4 = Panel(python_4.my_d)
panel_5 = Panel(python_4.a)
draw_2 = Draw(cg=[python_5.origin_frames, python_5.pick_frames, python_5.bricks])  # -> rg; same code as draw
