# Grasshopper definition 001_compas_geometry.ghx (Grasshopper 1.0.7)

# TUESDAY
# 1. Example for dictionary(simplified)
# 2. Simple examples compas geo
# 3. Curve Division example with json compass geo
# LUNCH
# 4. Rhino geo to compas frames to json
# 5. Prepare json files for Wednesday, to test on Robot
# 
# 4PM Design++ Lecture
# MONDAY
# 1. Class example
# 2. Full workflow with classes
# 
# LUNCH
# 
# 3. Students working time
button = Button()
write_to_json = GhPythonScript(trigger=button)  # -> out, pick_frames, center_frames, meshes, dict
# ---------- write_to_json: Python ----------
import Rhino.Geometry as rg
from compas.geometry import Box
from compas.geometry import Frame
from compas.geometry import Point
from compas.geometry import Translation
import compas
import sys
import os

canvas = ghenv.Component.OnPingDocument()           #gets current filepath of ghDoc, aternatively can use ghdoc.Path
current_folder = os.path.dirname(canvas.FilePath)   #gets parent directory of the file(folder of the current file)
parent_folder = os.path.dirname(current_folder)     #gets parent of the current folder

output_folder = os.path.join(parent_folder, 'data')             #point to the 'data' directory located in the parent folder
output_file = os.path.join(output_folder, '001_boxes.json')     #creates a path with the output file name


box_dict = {'mesh':[],'frame':[], 'center':[]}  #creates an empty dictionary with 'mesh', 'frame' and 'center' as empty lists

b_count = 10    #number of boxes

spacing = 2.5   #spacing between each box
length  = 50    #length of a single box
width   = 25    #width of a single box
height  = 12.5  #height of a single box

for x in range(b_count):
    #Create a base frame for each box
    frame = Frame((x*length + spacing * x,0,0),(1,0,0),(0,1,0))     #COMPAS.Geometry Frame as center of each box
    box = Box(frame, length, width, height)                         #COMPAS.Geometry Box created at each frame object, Mesh Datatype
    box_dict['mesh'].append(box)                                    #Appends the Box mesh to the dictionary
    center_frame = box.frame                                        #Center of each box as 'frame' attribute, note: compas attributes are not in CAPS
    box_dict['center'].append(center_frame)                         #Appends center to dictionary
    translation_matrix = Translation.from_vector((0,0,height/2))    #Translation transformation from COMPAS.Geometry stored as transformation matrix
    pick_frame = center_frame.transformed(translation_matrix)       #Using transformation matrix to transform the center frame, note: transform() vs transformed()
    box_dict['frame'].append(pick_frame)                            #Appends pick frame to the dictionary


pick_frames = box_dict['frame']         #Access frames for viz
center_frames = box_dict['center']      #Access frames for viz
meshes = box_dict['mesh']               #Access frames for viz


#Write to JSON if button pressed
if trigger:
    #Write the whole dictionary to a JSON serialized file at output location created earlier, 'pretty' makes it pretty
    compas.json_dump(box_dict, output_file, pretty = True) #Yay
# ---------- end write_to_json ----------
python = GhPythonScript()  # -> out, box
# ---------- python: Python ----------
import Rhino.Geometry as rg
from compas.geometry import Box
from compas.geometry import Frame, Point, Vector

#COMPAS frame object at (0,0,0)
#frame = Frame((0,0,0),(1,0,0),(0,1,0))
frame = Frame(Point(0,0,0),Vector(1,0,0),Vector(0,1,0))

#COMPAS Geometry Box
box = Box(frame, 50, 50, 50)
# ---------- end python ----------
panel = Panel(python.box)
draw = Draw(cg=write_to_json.pick_frames)  # -> rg
#   port cg: The COMPAS geometry or datastructure to be drawn.
#   port rg: The Rhino geometry object.
# ---------- draw: Python ----------
"""
Draws COMPAS geometry in Grasshopper.
"""
from ghpythonlib.componentbase import executingcomponent as component

from compas.artists import Artist


class CompasToRhinoGeometry(component):
    def RunScript(self, cg):
        if not cg:
            return None

        return Artist(cg).draw()
# ---------- end draw ----------
draw_2 = Draw(cg=write_to_json.center_frames)  # -> rg; same code as draw
# WEDNESDAY
# 1. UR RTDE INSTALLATION and Intro(Gonzalo?)
# 2. Read from JSON and send to ROBOT using RTDE wrapper
# 
# LUNCH
# 
# 3. Students do their own files with RTDE test and debug with tutors
# TUESDAY
# 1. Show methods with image mapping, rotation etc
# 
# LUNCH
# 
# 2. Students work on their projects
draw_3 = Draw(cg=write_to_json.meshes)  # -> rg; same code as draw

python_2 = GhPythonScript(box=python.box)  # -> out, rhino_box
# ---------- python_2: Python ----------
from compas_rhino.conversions import box_to_rhino

#Converts COMPAS box to Rhino box
rhino_box = box_to_rhino(box)
# ---------- end python_2 ----------
draw_4 = Draw(cg=python.box)  # -> rg; same code as draw

panel_2 = Panel(python_2.rhino_box)
geo = Geometry(python_2.rhino_box)  # disabled
# SOMEDAY
read_from_json = GhPythonScript(filename="001_boxes.json")  # -> out, frames
# ---------- read_from_json: Python ----------
import Rhino.Geometry as rg
from compas.geometry import Box
from compas.geometry import Frame
from compas.geometry import Point
from compas.geometry import Translation
import compas
import sys
import os

canvas = ghenv.Component.OnPingDocument()           #gets current filepath of ghDoc, aternatively can use ghdoc.Path
current_folder = os.path.dirname(canvas.FilePath)   #gets parent directory of the file(folder of the current file)
parent_folder = os.path.dirname(current_folder)     #gets parent of the current folder


input_folder = os.path.join(parent_folder, 'data')          # point to the 'scripts' directory
input_file = os.path.join(input_folder, filename)           # point to the input file with the exact name with extension(.json)

box_dict = compas.json_load(input_file) #Uses json_load from COMPAS core to read JSON files

frames = box_dict['frame'] #Access frame from the stored dictionary in JSON
# ---------- end read_from_json ----------
python_3 = GhPythonScript(rhino_box=python_2.rhino_box)  # -> out, compas_box; inputs rhino_box: Box
# ---------- python_3: Python ----------
from compas_rhino.conversions import box_to_compas

compas_box = box_to_compas(rhino_box)
# ---------- end python_3 ----------
panel_3 = Panel(python_3.compas_box)
# FRIDAY
# THURSDAY
# 1. Python best practices
# 2. Intro to project endless wall
# 3.  Simple brick and pick and place example
# 
# LUNCH
# 
# 4. Students form groups test workflow and figure out concepts
# 1. Brainstorm and develop ideas
# 2. Small tutorial or excercize depending on feedback from students
# COMPAS wall example
draw_5 = Draw(cg=read_from_json.frames)  # -> rg; same code as draw
