# Grasshopper definition 101_forward_kinematics.ghx (Grasshopper 1.0.7)

forward_kinematics = GhPythonScript()  # -> out, a
# ---------- forward_kinematics: Python ----------
from compas.artists import Artist
from compas.robots import RobotModel

model = RobotModel.ur5(load_geometry=True)

# Get some relevant link names for FK
base = model.get_base_link_name()
endeffector = model.get_end_effector_link_name()
print(base)
print(endeffector)

# Create config
config = model.zero_configuration()

# Get FK for tip
frame_tip = model.forward_kinematics(config)
print(frame_tip)

# Get FK for base
frame_base = model.forward_kinematics(config, link_name=base)
print(frame_base)

a = []
artist = Artist(frame_tip)
a.append(artist.draw())

artist = Artist(frame_base)
a.append(artist.draw())

artist = Artist(model)
artist.update(config)
a.extend(artist.draw())
# ---------- end forward_kinematics ----------
panel = Panel(forward_kinematics.out)
