# Grasshopper definition 201_assembly.ghx (Grasshopper 1.0.7)

# ----
# Connect assembly
button = Button()
load = GhPythonScript(start=button)  # -> assembly
# ---------- load: Python ----------
import os
import sys
import compas

canvas = ghenv.Component.OnPingDocument()
folder = os.path.dirname(canvas.FilePath)
if folder not in sys.path:
    sys.path.append(folder)

session = compas.json_load(os.path.join(folder, 'session.json'))
assembly = session['assembly']
# ---------- end load ----------
connect = GhPythonScript(assembly=load, save=Toggle(False))  # -> assembly
# ---------- connect: Python ----------
import math
import os

import compas
from compas.geometry import Box
from compas.geometry import Plane
from compas.geometry import Frame
from compas.geometry import Vector
from compas.geometry import Translation
from compas.geometry import Polygon
from compas.geometry import Projection
from compas.datastructures import Mesh
from separation_axis_theorem import separating_axis_theorem

canvas = ghenv.Component.OnPingDocument()
folder = os.path.dirname(canvas.FilePath)

projection = Projection.from_plane(Plane.worldXY())

for part in assembly.parts():
    # Store XY projection
    projected_mesh = Mesh.from_shape(part.geometry.transformed(projection))
    part.attributes['projection'] = Polygon(projected_mesh.face_coordinates(0))

    # Calculate place frame
    part.attributes['place_frame'] = part.frame.transformed(Translation.from_vector([0, 0, part.attributes['zsize']]))

# Connect assembly graph
last_course_parts = None
for c in range(assembly.attributes['courses'] + 1):
    course_parts = list(assembly.graph.nodes_where_predicate(lambda key, attr: attr['part'].attributes['course'] == c))

    if last_course_parts:
        for key in course_parts:
            part1 = assembly.find_by_key(key)
            polygon1 = part1.attributes['projection']

            for p2_key in last_course_parts:
                part2 = assembly.find_by_key(p2_key)
                polygon2 = part2.attributes['projection']
                are_connected = separating_axis_theorem(polygon1.points, polygon2.points)
                if are_connected:
                    assembly.add_connection(part2, part1)

    last_course_parts = course_parts

if save:
    compas.json_dump({'assembly': assembly}, os.path.join(folder, 'session.json'), pretty=True)
# ---------- end connect ----------
viz = GhPythonScript(assembly=connect)  # -> out, a
# ---------- viz: Python ----------
import compas_ghpython
from compas.artists import Artist

def draw_connections(assembly):
    lines = []

    for u, v in assembly.connections():
        u = assembly.find_by_key(u)
        v = assembly.find_by_key(v)
        lines.append(
            {
                "start": list(u.frame.point),
                "end": list(v.frame.point),
            }
        )
    return compas_ghpython.draw_lines(lines)

a = []
a += draw_connections(assembly)
# ---------- end viz ----------
