# Grasshopper definition 202_assembly.ghx (Grasshopper 1.0.7)

# ----
# Viz assembly sequence
button = Button()
load = GhPythonScript(load=button)  # -> assembly
# ---------- load: Python ----------
import os
import sys
import compas

canvas = ghenv.Component.OnPingDocument()
folder = os.path.dirname(canvas.FilePath)
if folder not in sys.path:
    sys.path.append(folder)

session = compas.json_load(os.path.join(folder, 'session.json'))
assembly = session['assembly']
# ---------- end load ----------
select_part = GhPythonScript(assembly=load, current_part_index=Slider(38, range=0..160))  # -> current_part, place_frame, a; inputs current_part_index: Int32
# ---------- select_part: Python ----------
from helpers import traverse
from helpers import draw_parts
from helpers import draw_connections
from helpers import draw_parts_attribute
from helpers import get_assembly_sequence
from compas.artists import Artist


a = []
a = draw_parts(assembly)
a += draw_connections(assembly)
a += draw_parts_attribute(assembly, 'place_frame')

top_course = assembly.attributes["courses"]
sequence = get_assembly_sequence(assembly, top_course)

for i in range(current_part_index):
    part = assembly.find_by_key(sequence[i])
    if (current_part_index-1) == i:
        place_frame = part.attributes['place_frame']
        current_part = part

    a += [Artist(part.geometry).draw()]
# ---------- end select_part ----------
