# Grasshopper definition 203_assembly.ghx (Grasshopper 1.0.7)

# ----
# Plan assembly
button = Button()
load = GhPythonScript(load=button)  # -> assembly
# ---------- load: Python ----------
import os
import sys
import compas

canvas = ghenv.Component.OnPingDocument()
folder = os.path.dirname(canvas.FilePath)
if folder not in sys.path:
    sys.path.append(folder)

session = compas.json_load(os.path.join(folder, 'session.json'))
assembly = session['assembly']
# ---------- end load ----------
select_part = GhPythonScript(assembly=load, current_part_index=Slider(1, range=0..160))  # -> current_part, place_frame, a; inputs current_part_index: Int32
# ---------- select_part: Python ----------
from helpers import traverse
from helpers import draw_parts
from helpers import draw_connections
from helpers import draw_parts_attribute
from helpers import get_assembly_sequence
from compas.artists import Artist


a = []
a = draw_parts(assembly)
a += draw_connections(assembly)
a += draw_parts_attribute(assembly, 'place_frame')

top_course = assembly.attributes["courses"]
sequence = get_assembly_sequence(assembly, top_course)

for i in range(current_part_index):
    part = assembly.find_by_key(sequence[i])
    if (current_part_index-1) == i:
        place_frame = part.attributes['place_frame']
        current_part = part

    a += [Artist(part.geometry).draw()]
# ---------- end select_part ----------

# ----
# Robotic planning
button_2 = Button()
panel = Panel("1. Load robot")
pt = ConstructPoint(XCoordinate=Slider(0.1, range=0..1), YCoordinate=Slider(0, range=0..1), ZCoordinate=Slider(0, range=0..1))
tool_frame = ToolFrame(O=pt, C=pt)
mesh = Mesh(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)
panel_2 = Panel("2. Attach tool")
pt_2 = Point(Point(-0.3411376823, 0.6627660137, 0.06882013759))
pick_frame = PickFrame(O=pt_2)
panel_3 = Panel("3. Solve IK")
number_slider = Slider(0, range=0..10)
panel_4 = Panel("4. Visualize")

# ==== cluster PickFrame
O = ClusterInput()
xy = XYPlane(Origin=O)
pflip = FlipPlane(Plane=xy, ReverseX=False, ReverseY=False, SwapAxes=True)
pi = Pi(Factor=0.5)
prot = RotatePlane(Plane=pflip, Angle=pi)
P = ClusterOutput(prot)

# ==== cluster ToolFrame
O = ClusterInput()
pi = Pi(Factor=0.5)
Y = UnitY(Factor=1)
xy = XYPlane(Origin=O)
C = ClusterInput()
rot3d = Rotate3D(Geometry=xy, Angle=pi, Center=C, Axis=Y)  # -> Geometry, Transform
G = ClusterOutput(rot3d.Geometry)
