# Grasshopper definition 300_ur_rtde.ghx (Grasshopper 1.0.7)

xy = XYPlane(Origin="400,50,100")
planes_to_frames = GhPythonScript(planes=xy)  # -> out, compas_frames; inputs planes: list of Plane
# ---------- planes_to_frames: Python ----------
import Rhino.Geometry as rg
from compas.geometry import Frame

from compas_rhino.conversions import plane_to_compas_frame

def plane_to_frame(plane):
    point = plane.Origin.X, plane.Origin.Y, plane.Origin.Z
    compas_frame = Frame(point, plane.XAxis, plane.YAxis)
    return compas_frame

compas_frames = []
for p in planes:
    c_frame = plane_to_compas_frame(p)
    compas_frames.append(c_frame)
# ---------- end planes_to_frames ----------

# ----
# Send to a config using UR RTDE
toggle = BooleanToggle(True)

# ----
# Get current config
button = Button()
get_config = GhPythonScript(send=button, ip="192.168.10.10")  # -> config, a
# ---------- get_config: Python ----------
import os
from scriptcontext import sticky as st
#sticky is a persistent dictionary which can save values and also be acessed by other GH components
#we use it here with a custom key to store values we read from the robot
from compas.rpc import Proxy

config_key = 'config_{}'.format(str(ghenv.Component.InstanceGuid))
new_key = 'new_key_{}'.format(str(ghenv.Component.InstanceGuid))
if config_key not in st:
    st[config_key] = None

if send:
    canvas = ghenv.Component.OnPingDocument()
    path = os.path.abspath(os.path.dirname(canvas.FilePath))
    rtde = Proxy('fabrication', path=path)
    
    st[config_key] = rtde.get_config(ip=ip)
    st[new_key] = rtde.get_config(ip=ip)
#    a = rtde.get_config(ip=ip)
config = st[config_key]
# ---------- end get_config ----------

move_to_config = GhPythonScript(
    config=get_config.config,
    speed=Slider(0.24, range=0..2),
    accel=Slider(0.1, range=0..3.14),
    send=Button(),
    ip="192.168.10.10")  # -> a
# ---------- move_to_config: Python ----------
import os
import math

from compas.rpc import Proxy

if send:
    if not config:
        ghenv.Component.Message = "No config to move to!"
    else:
        canvas = ghenv.Component.OnPingDocument()
        path = os.path.abspath(os.path.dirname(canvas.FilePath))
        rtde = Proxy('fabrication', path=path)
        nowait = True
        a = rtde.move_to_joints(config, speed, accel, nowait, ip=ip)
        ghenv.Component.Message = "Sent config"
# ---------- end move_to_config ----------

# ----
# Toggle freedrive to move robot
toggle_2 = BooleanToggle(False)
toggle_freedrive = GhPythonScript(ip="192.168.10.10", start_teach_mode=toggle_2, stop_teach_mode=Toggle(True))  # -> a
# ---------- toggle_freedrive: Python ----------
import os
import math

from compas.rpc import Proxy

if start_teach_mode:   
    canvas = ghenv.Component.OnPingDocument()
    path = os.path.abspath(os.path.dirname(canvas.FilePath))
    rtde = Proxy('fabrication', path=path)                         # stay in teach moded(freedrive) as long as this is True
    a = rtde.start_teach_mode(ip=ip)            # send message to robot
    ghenv.Component.Message = "Freedrive on"    # display message on GH component

if stop_teach_mode:   
    canvas = ghenv.Component.OnPingDocument()
    path = os.path.abspath(os.path.dirname(canvas.FilePath))
    rtde = Proxy('fabrication', path=path)                          # stop teach mode if stop button pressed
    a = rtde.stop_teach_mode(ip=ip)             # send message to robot   
    ghenv.Component.Message = "Freedrive off"   # display message on GH component
# ---------- end toggle_freedrive ----------

# ----
# Send single target using UR RTDE
number_slider = Slider(0.3, range=0..2)
move_to_target = GhPythonScript(
    frame=planes_to_frames.compas_frames,
    speed=number_slider,
    accel=Slider(0.1, range=0..3.14),
    send=Button(),
    ip="192.168.10.10")  # -> a
# ---------- move_to_target: Python ----------
import os
import math
from compas.rpc import Proxy


if send:
    if not frame:
        ghenv.Component.Message = "No frame to move to!"
    else:
        canvas = ghenv.Component.OnPingDocument()
        path = os.path.abspath(os.path.dirname(canvas.FilePath))
        rtde = Proxy('fabrication', path=path)
        radius = 0.1
        a = rtde.move_to_target(frame, speed, accel, radius, ip=ip)
        ghenv.Component.Message = "Sent frame"
# ---------- end move_to_target ----------

panel = Panel(get_config.config)
python = GhPythonScript()  # -> out, a
# ---------- python: Python ----------
import Rhino.Geometry as rg

from scriptcontext import sticky

print sticky
# ---------- end python ----------
