# Grasshopper definition 301_ur_rtde_extended.ghx (Grasshopper 1.0.7)

crv = Curve(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)
divide = DivideCurve(Curve=crv, Count=10, Kinks=False)  # -> Points, Tangents, Parameters
# COMPAS Info!
info = Info()  # -> info
#   port info: Environment info.
# ---------- info: Python ----------
"""
Displays information about the active COMPAS environment.
"""
import compas_bootstrapper
from ghpythonlib.componentbase import executingcomponent as component

import compas


class CompasInfo(component):
    def RunScript(self):
        self.Message = "COMPAS v{}".format(compas.__version__)
        info = "COMPAS Version: {}\nEnvironment: {}"
        return info.format(compas.__version__, compas_bootstrapper.ENVIRONMENT_NAME)
# ---------- end info ----------
hframes = HorizontalFrames(Curve=crv, Count=10)  # -> Frames, Parameters
xy = XYPlane(Origin=divide.Points)

# ----
# COMPAS RPC
# 
# https://compas.dev/compas/latest/api/compas.rpc.html
python = GhPythonScript()  # -> path
# ---------- python: Python ----------
import os

canvas = ghenv.Component.OnPingDocument()
path = os.path.abspath(os.path.dirname(canvas.FilePath))
# ---------- end python ----------
python_2 = GhPythonScript(module="fabrication", path=python, start=Toggle(False), stop=Button(), restart=Button())  # -> rtde
# ---------- python_2: Python ----------
"""
SOURCE: https://compas.dev/compas/latest/api/compas.rpc.html
"""

# import compas rpc Proxy module
# this enables a Remote Procedure Call between Iron Python running on GH to the python 3.XX 
# thus helping us use modules like numpy, scipy, and many others which cannot be natively run in IronPython 
from compas.rpc import Proxy

#start Proxy server 
if start:
    #call proxy server to start given module
    rtde = Proxy(module, path=path)
    #restart if needed, if module is updated or in case of bugs
    if restart:
        rtde.restart_server()

#stop server
if stop:
    rtde.stop_server()
# ---------- end python_2 ----------

xy_2 = XYPlane(Origin="400,50,100")

# ----
# IP Address of Robot
panel = Panel("192.168.10.10")

planes_to_frames = GhPythonScript(planes=xy_2)  # -> out, compas_frames; inputs planes: list of Plane
# ---------- planes_to_frames: Python ----------
import Rhino.Geometry as rg
from compas.geometry import Frame

def plane_to_frame(plane):
    point = plane.Origin.X, plane.Origin.Y, plane.Origin.Z
    compas_frame = Frame(point, plane.XAxis, plane.YAxis)
    return compas_frame

compas_frames = []
for p in planes:
    c_frame = plane_to_frame(p)
    compas_frames.append(c_frame)
# ---------- end planes_to_frames ----------

# ----
# Read values from robot
button = Button()
get_config = GhPythonScript(rtde=python_2, ip=panel, send=button)  # -> config
# ---------- get_config: Python ----------
import os
from scriptcontext import sticky as st
#sticky is a persistent dictionary which can save values and also be acessed by other GH components
#we use it here with a custom key to store values we read from the robot

config_key = 'config_{}'.format(str(ghenv.Component.InstanceGuid)) # create a config key with unique GUID of current component

if config_key not in st: 
    st[config_key] = None #if sticky doesn't contain a value in the dict, then it's None 

if send:
    st[config_key] = rtde.get_config(ip=ip) # if value received from robot, then it stores current config

config = st[config_key] # assign current config to output
# ---------- end get_config ----------
panel_2 = Panel(get_config)

# ----
# Send single target using UR RTDE
number_slider = Slider(0.58, range=0..2)
move_to_target = GhPythonScript(
    rtde=python_2,
    frame=planes_to_frames.compas_frames,
    speed=number_slider,
    accel=Slider(0.1, range=0..3.14),
    send=Button(),
    ip=panel)  # -> a
# ---------- move_to_target: Python ----------
import os
import math

if send:
    if not frame:
        ghenv.Component.Message = "No frame to move to!"
    else:
        radius = 0.1
        a = rtde.move_to_target(frame, speed, accel, radius, ip=ip)
        ghenv.Component.Message = "Sent frame"
# ---------- end move_to_target ----------

# ----
# Send multiple targets using UR RTDE
number_slider_2 = Slider(0.15, range=0..2)
move_to_target_2 = GhPythonScript(rtde=python_2, speed=number_slider_2, accel=Slider(0.1, range=0..3.14), send=Button(), stop=Button(), ip=panel)  # -> a; inputs frames: list
# ---------- move_to_target_2: Python ----------
import os
import math
import Grasshopper.Kernel as gh

test = True

# send command to robot if toggle is on
if send:
    # if frames are empty, then adds message to component 
    if not frames:
        #this is a nice and simple way to annotate information when making custom python components
        ghenv.Component.Message = "No frame to move to!"
    # if frames provided, calls function from fabrication module, which sends the frames asyncronously
        radius = 0.1 #blend radius if needed
        a = rtde.move_to_path(frames, speed, accel, radius, ip= ip) # takes a list of COMPAS frames, speed, accel, radii and IP address
        ghenv.Component.Message = "Sent frames" # update GH component message
if stop:
    # interrupt if stop button pressed
    a = rtde.stop(accel, ip = ip)

elif test:
    # test mode to create path and check what values are being sent to robot
    a = rtde.create_path(frames, speed, accel, 0.1)
    print a
# ---------- end move_to_target_2 ----------

# ----
# Send a routine sequence for pick and place using UR RTDE
number_slider_3 = Slider(0.15, range=0..2)
pick_and_place = GhPythonScript(
    pick_frame=planes_to_frames.compas_frames,
    speed=number_slider_3,
    accel=Slider(0.1, range=0..3.14),
    send=Button(),
    ip=panel)  # -> a; inputs frames: list
# ---------- pick_and_place: Python ----------
import os
import math
import time
import Grasshopper.Kernel as gh
from compas.rpc import Proxy
from compas.geometry import Translation, Vector

SAFE_DIST = 50
VACCUM_PIN = 4

pick_frame = pick_frame #static picking up location
pick_safety_frame = pick_frame.transformed(Translation.from_vector(Vector(0,0,SAFE_DIST))) #static safety plane 

if send:
    if not frames: #if no frames provided, then display message
        ghenv.Component.Message = "No frame to move to!"
    else:
        for f in frames:
            #move to pick safety plane
            rtde.move_to_target(pick_safety_frame, speed, accel, False, ip = ip)
            #move to pick plane
            rtde.move_to_target(pick_frame, speed, accel, False, ip = ip)
            #turn IO on
            rtde.set_digital_io(VACCUUM_PIN,1,ip=ip)
            #sleep on position to give some time to pick up
            time.sleep(0.5)
            #move to pick safety plane
            rtde.move_to_target(pick_safety_frame, speed, accel, False, ip = ip)
            #move to pre placement frame
            pre_place_frame = f.transformed(Translation.from_vector(Vector(0,0,50)))
            rtde.move_to_target(pre_place_frame, speed, accel, False, ip = ip)
            #move to placement frame
            rtde.move_to_target(f, speed, accel, False, ip = ip)
            #turn vaccuum off to place brick
            rtde.set_digital_io(VACCUUM_PIN,0,ip=ip)
            #sleep robot to make sure it is placed
            time.sleep(1.0)
            #move to post placement frame
            post_place_frame = f.transformed(Translation.from_vector(Vector(0,0,50)))
            rtde.move_to_target(post_place_frame, speed, accel, False, ip = ip)
        ghenv.Component.Message = "Sent frames" #display message on component
# ---------- end pick_and_place ----------

# ----
# Toggle freedrive to move robot
toggle = BooleanToggle(False)
toggle_freedrive = GhPythonScript(rtde=python_2, ip=panel, start_teach_mode=toggle, stop_teach_mode=Toggle(False))  # -> a
# ---------- toggle_freedrive: Python ----------
import os
import math

canvas = ghenv.Component.OnPingDocument()                   # get current file of gh canvas
path = os.path.abspath(os.path.dirname(canvas.FilePath))    # get directoy path

if start_teach_mode:                            # stay in teach moded(freedrive) as long as this is True
    a = rtde.start_teach_mode(ip=ip)            # send message to robot
    ghenv.Component.Message = "Freedrive on"    # display message on GH component

if stop_teach_mode:                             # stop teach mode if stop button pressed
    a = rtde.stop_teach_mode(ip=ip)             # send message to robot   
    ghenv.Component.Message = "Freedrive off"   # display message on GH component
# ---------- end toggle_freedrive ----------
