# Grasshopper definition 302_ur_script_pick_place.gh (Grasshopper 1.0.7)

# ---- group: BRICK DIMENSIONS / width
panel = Panel("15")

# ---- group: BRICK DIMENSIONS / height
panel_2 = Panel("10")

# ---- group: BRICK DIMENSIONS / length
panel_3 = Panel("30")

# ---- group: GET CRV PLANES
crv = Curve(<curve referenced from the Rhino model>)
python = GhPythonScript(crv=crv, height=panel_2, length=panel_3, width=panel)  # -> planes, brick_meshes; inputs crv: Curve
# ---------- python: Python ----------
"""
MasDfab 22-23

Basic example to get planes from crv

"""

import Rhino.Geometry as rg
import copy



def brick(pln):
    """ List of rg.Points definding the corners of the brick 
    
    Returns
    ----------
    [pt0 : bottom point at negative x and negative y,
    pt1 : bottom point at negative x and positive y,
    pt2 : bottom point at positive x and positive y,
    pt3 : bottom point at positive x and negative y,
    pt4 : pt0 + height,
    pt5 : pt1 + height,
    pt6 : pt2 + height,
    pt7 : pt3 + height]
    """
    

    
    origin = pln.Origin
    
    x_vec = pln.XAxis 
    y_vec = pln.YAxis 
    z_vec = pln.ZAxis
    
    pt_0 = origin - (x_vec *width/2) - (y_vec *length/2)
    pt_1 = origin + (x_vec *width/2) - (y_vec *length/2)
    pt_2 = origin + (x_vec *width/2) + (y_vec *length/2)
    pt_3 = origin - (x_vec *width/2) + (y_vec *length/2)
    
    pt_4 = pt_0 + (z_vec*height)
    pt_5 = pt_1 + (z_vec*height)
    pt_6 = pt_2 + (z_vec*height)
    pt_7 = pt_3 + (z_vec*height)
    
    pts = [pt_0, pt_1, pt_2, pt_3, pt_4, pt_5, pt_6, pt_7]
    
    
    return pts

def mesh(pts):
    """Mesh  depicting the brick:

    Returns
    ----------
    mesh_brick : Mesh
    """
    mesh_brick = rg.Mesh.CreateFromBox(pts, 1,1,1)
    return mesh_brick

def pick_plane(plane):
    """offsets the plane of the brick with its height. 
    Returns
    ----------
    pick_plane : rg.Plane
    """
    
    offset_vec = plane.ZAxis * height
    pick_plane = copy.copy(plane)
    pick_plane.Translate(offset_vec) 
    
    return pick_plane


gap = 5
params = crv.DivideByLength(length+gap,True)
planes = []

for i in params:
    
    p = crv.PointAt(i)
    t = crv.TangentAt(i)
    
    v = rg.Vector3d.CrossProduct(t, rg.Vector3d.ZAxis)
    
    pn =  rg.Plane(p,v,t)
    
    planes.append(pn)



brick_pts = [brick(p) for p in planes]
brick_meshes = [mesh(m) for m in brick_pts]
brick_planes = [pick_plane(p) for p in planes]
# ---------- end python ----------
pln = Plane(python.planes)
mesh = Mesh(python.brick_meshes)

# ---- group: FABRICATION WORKFLOW
python_2 = GhPythonScript(brick_planes=pln, fabricate=Button())  # -> script, vis_planes, pick_up_plane; inputs brick_planes: list of Plane, fabricate: Boolean
# ---------- python_2: Python ----------
from imp import reload
import Rhino.Geometry as rg
import simple_ur_script as ur
reload(ur)
import simple_comm as c
reload(c)
import math as m


# change these values if needed
ROBOT_IP = "192.168.10.10"
SAFE_ROBOT_ACC = 0.1
SAFE_ROBOT_VEL = 0.1
IO = 4




def tcp(script):
    script += ur.set_tcp_by_angles(0.0, 0.0, 80.0, m.radians(0.0), m.radians(180.0),m.radians(0.0))
    
    return script


def set_robot_base():
    pt_0 = rg.Point3d(327,230,-10) # base plane origin
    pt_1 = rg.Point3d(499,230,-10) # point on positive x axis
    pt_2 = rg.Point3d(499,499,-10) # point on positive xy plane
    robot_base = rg.Plane(pt_0,pt_1-pt_0,pt_2-pt_0)
    return robot_base


def rhino_to_robot_space(rhino_plane):
    plane = rhino_plane.Clone()
    robot_base_plane = set_robot_base()
    rhino_matrix = rg.Transform.PlaneToPlane(rg.Plane.WorldXY,robot_base_plane)
    plane.Transform(rhino_matrix)
    return plane


def pickup_brick(script,pick_up_plane):
    planes = []
    #change the distance if needed
    SAFE_DIST = 150
    
    safe_plane = pick_up_plane.Clone()
    safe_plane.Translate(rg.Vector3d.ZAxis*SAFE_DIST)
    
    ## add to the path: go to the safe plane
    script += ur.move_l(safe_plane, SAFE_ROBOT_ACC, SAFE_ROBOT_VEL)
    planes.append(safe_plane)
    
    ## add to the path: go to the pick up plane
    script += ur.move_l(pick_up_plane, SAFE_ROBOT_ACC, SAFE_ROBOT_VEL)
    planes.append(pick_up_plane)
    
    ## add to the path: turn on the vacuum and wait 1 sec.
    script += ur.set_digital_out(IO,True)
    script += ur.sleep(1)

    # add to the path: go back to the safe_plane
    script += ur.move_l(safe_plane, SAFE_ROBOT_ACC, SAFE_ROBOT_VEL)
    planes.append(safe_plane)
    
    
    return script, planes


def place_brick(script, place_plane):
    
    planes = []
    
    SAFE_DIST = 100
    safe_plane = place_plane.Clone()
    safe_plane.Translate(rg.Vector3d.ZAxis*SAFE_DIST)
    
    # add to the path: go to the safe plane
    script += ur.move_l(safe_plane, SAFE_ROBOT_ACC, SAFE_ROBOT_VEL)
    planes.append(safe_plane)
    
    # add to the path: go to the place plane
    script += ur.move_l(place_plane, SAFE_ROBOT_ACC, SAFE_ROBOT_VEL)
    planes.append(place_plane)
    
    ## add to the path: turn off the vacuum and wait 1 second (hold the brick)
    script += ur.set_digital_out(IO,False)
    script += ur.sleep(1)
    
    # add to the path: go back to the safe plane
    script += ur.move_l(safe_plane, SAFE_ROBOT_ACC, SAFE_ROBOT_VEL)
    planes.append(safe_plane)
    
    return script,planes


def send(script):
    script = c.concatenate_script(script)
    c.send_script(script, ROBOT_IP)
    return script 


#location of a pick up station
pick_station = rg.Plane(rg.Point3d(0, 450, -3.5), rg.Vector3d.XAxis, rg.Vector3d.YAxis)


script = ""
script = tcp(script)
vis_planes = []



# translate from rhino to robot_space and iterate through all planes
robot_planes = []

for p in brick_planes:
    r_plane = rhino_to_robot_space(p)
    robot_planes.append(r_plane)


for b_plane in robot_planes:
    
    script, p = pickup_brick(script,pick_station)
    vis_planes.extend(p) #only to visualize the planes
    
    script, p = place_brick(script,b_plane)
    vis_planes.extend(p)


if fabricate:
    send(script)
# ---------- end python_2 ----------
pln_2 = Plane(python_2.vis_planes)
panel_4 = Panel(python_2.script)
