# Grasshopper definition 303_class_brickwall.gh (Grasshopper 1.0.7)

angle = Slider(33, range=-90..90)
crv = Curve(<curve referenced from the Rhino model>)
python = GhPythonScript(crv=crv, layer_num=Slider(30, range=0..100), bricks_num=Slider(22, range=0..100), bricks_angle=angle)  # -> out, a, pt_bricks, crvs, bricks; inputs crv: Curve, layer_num: Int32, bricks_num: Int32, bricks_angle: Int32
# ---------- python: Python ----------
import rhinoscriptsyntax as rs
import Rhino.Geometry as rg
import math
import copy
import System
import ghpythonlib.treehelpers as th

length = 30
width = 15
height = 10



class Brickwall(object):
    
    """
    this is a class to create a wall from a input curve and get the origin for its bricks
    
    """
    
    # this varible was defined outside of the class
    # we need to declare it as global so it will be shared by all instances of the class
    global height
    
    
    # this method gets calles as soon as the object of a class is initiated
    # here we define instance variables = attributes of the object
    def __init__(self,curve,layer_cnt, brick_cnt):
        
        self.curve = curve
        self.layer_cnt = layer_cnt
        self.brick_cnt = brick_cnt
        
        self.crvs = self.get_layers()
        self.bpts,self.bpts_tan = self.get_bricks()
        
    # this method will be called in the __init__ function
    # it returns a list of curves 
    def get_layers(self):
        
        crvs = []
        for i in range(self.layer_cnt):
            T = rg.Transform.Translation(rg.Vector3d(0,0,i*height))
            c = copy.copy(self.curve)
            c.Transform(T)
            crvs.append(c)
        return crvs
    
    # this method will be called in the __init__ function as well
    # it divides the curves into points and returns the list of points and its tangents
    def get_bricks(self):
        
        bricks = []
        bricks_tan = []
        
        for i, c in enumerate(self.crvs):
            params = c.DivideByCount(self.brick_cnt*2,True)
            pts = []
            tngts = []
            # list comprehension
            pts = [ c.PointAt(p) for p in params[i%2::2]]
            tngts = [ c.TangentAt(p) for p in params[i%2::2]]
                
            bricks.append(pts)
            bricks_tan.append(tngts)
            
        return bricks,bricks_tan


class Brick(object):
    
    """
    this is a class to make a brick
    """
    
    global length
    global width
    global height

    # this method gets calles as soon as the object of a class is initiated
    # here we define instance variables = attributes of the object
    def __init__(self, origin, vec):
        
        
        self.origin = origin 
        self.vec = vec # point's tangent vector

        
        self.pts = self.brick_pts()
        
        self.start_plane = self.get_start_plane()
        self.target_plane = self.get_target_plane()
        
        self.mesh = self.brick_mesh()
        
        
    # this method will be called in the __init__ function
    # it returns a list of 8 points of the bounding box 
    def brick_pts(self):
        
        pt_0 = rg.Point3d(self.origin.X-length/2, self.origin.Y-width/2, self.origin.Z)
        pt_1 = rg.Point3d(pt_0.X + length, pt_0.Y, self.origin.Z)
        pt_2 = rg.Point3d(pt_1.X, pt_1.Y + width, self.origin.Z)
        pt_3 = rg.Point3d(pt_2.X - length, pt_2.Y, self.origin.Z)

        pt_4 = rg.Point3d(pt_0.X, pt_0.Y, pt_0.Z + height)
        pt_5 = rg.Point3d(pt_1.X, pt_1.Y, pt_1.Z + height)
        pt_6 = rg.Point3d(pt_2.X, pt_2.Y, pt_2.Z + height)
        pt_7 = rg.Point3d(pt_3.X, pt_3.Y, pt_3.Z + height)

        b_pts = [pt_0, pt_1, pt_2, pt_3, pt_4, pt_5, pt_6, pt_7]

        return b_pts
    
    # this method is called in the __init__ function
    # it returns the start_plane of the brick accodring to boolean input
    def get_start_plane(self):
        
        yvec = rg.Vector3d.CrossProduct(rg.Vector3d(0,0,1), self.vec)
        start_plane = rg.Plane(self.origin, self.vec, yvec)
            
        return start_plane
    
    # this method is called in the __init__ function
    # it returns the rotated start plabe plane according to input value 
    def get_target_plane(self):
        c = copy.copy(self.start_plane)
        c.Rotate(math.radians(bricks_angle), rg.Vector3d.ZAxis, self.origin)
        return c
    
    # this method is called in the __init__ funciton
    # it creates the mesh from 8 points, transforms its plane and returns the mesh 
    def brick_mesh(self):
        br = rg.Mesh.CreateFromBox(self.pts,1,1,1)
        P = rg.Plane(self.origin, rg.Vector3d.XAxis, rg.Vector3d.YAxis)
        T1 = rg.Transform.PlaneToPlane(P, self.start_plane)
        T2 = rg.Transform.PlaneToPlane(self.start_plane, self.target_plane)
        br.Transform(T1)
        br.Transform(T2)
        
        return br

# calling the object
wall = Brickwall(crv,layer_num,bricks_num)
# assigning its attribute to a variable crvs
crvs = wall.crvs
# to visualize the bricks in gh we transform it to a tree
pt_bricks = th.list_to_tree(wall.bpts)


bricks = []


for _pt,_t in zip(wall.bpts, wall.bpts_tan):
    for pt,t, in zip(_pt,_t):
        b = Brick(pt,t)
        bricks.append(b.mesh)
# ---------- end python ----------
pt = Point(flatten(python.pt_bricks))
crv_2 = Curve(python.crvs)
mesh = Mesh(python.bricks)
# #            for p in params[i%2::2]:
# #                pt = c.PointAt(p)
# #                t = c.TangentAt(p)
# #
# #                pts.append(pt)
# #                tngts.append(t)
preview = CustomPreview(Geometry=mesh, Material=ColourSwatch(SwatchColor=RGB(99, 107, 255)))
