# Grasshopper definition 306_inheritance_basics.ghx (Grasshopper 1.0.7)

number_slider = Slider(4, range=0..10)
pt = ConstructPoint(XCoordinate=0, YCoordinate=0, ZCoordinate=0)
xy = XYPlane(Origin=pt)
pt_2 = ConstructPoint(XCoordinate=number_slider, YCoordinate=number_slider, ZCoordinate=number_slider)
box = GhPythonScript(plane=xy, vector=pt_2)  # -> out, pretty_chair, volume, prettier_chair; inputs plane: Plane, vector: Vector3d
# ---------- box: Python ----------
import Rhino.Geometry as rg

class ElementBase(object): # parent class
    #Init function with properties for parent and child classes
    def __init__(self, name, position):
        self.name = name # Name or ID of object
        self.position = plane # Point3d
        self.geometry = None # Geometry
    #Functions will be inherited by all child classes
    def translate(self, vector):
        self.position.Translate(rg.Vector3d(vector))
    

class Chair(ElementBase): # child class of ElementBase
    #inherits the init from class ElementBase
    #additional functionality can be added as needed
    def create_geometry(self, size):
        #let's say chair is cube shaped
        xsize, ysize, zsize = [rg.Interval(-size/2, size/2)]*3 # multiply list by a number to repeat it
        # assign it to inherited property from ElementBase class
        self.geometry = rg.Box(self.position, xsize, ysize, zsize)
    #additional function not originally part of ElementBase class
    def get_volume(self):
        return self.geometry.Volume
        

class Table(ElementBase):
    #inherits the init from class ElementBase
    #additional functionality can be added as needed
    def __init__(self, name, position, color):
        ElementBase.__init__() # inherit init from ElementBase
        self.color = color
    #add more methods
    def get_height(self):
        pass

chair = Chair(name = 'pretty cube chair', position = plane)
chair.create_geometry(size = 10.5)

pretty_chair = chair.geometry #'attribute' inherited from class ElementBase
volume = chair.get_volume() #'method' of class Chair


#create another instance of the class
other_chair = Chair('prettier cube chair', plane)
other_chair.translate(vector) #'method' inherited from class ElementBase

other_chair.create_geometry(size = 8.5)

prettier_chair = other_chair.geometry
# ---------- end box ----------
python = GhPythonScript()  # -> Out, A
wireframebox = GhPythonScript()  # -> Out, A
