# Grasshopper definition 307_class_brickwall_methods.ghx (Grasshopper 1.0.7)

angle = Slider(0, range=-90..90)
srf = Surface(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)
crv = Curve(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)
python = GhPythonScript(
    srf=srf,
    layer_num=Slider(50, range=0..100),
    bricks_angle=angle,
    layer_index=Slider(13, range=0..24),
    att_index=Slider(8, range=0..13))  # -> out, a, pt_bricks, crvs, bricks, selected_mesh; inputs crv: Curve, srf: Surface, layer_num: Int32, bricks_angle: Int32, layer_index: Int32, att_index: Int32
# ---------- python: Python ----------
import rhinoscriptsyntax as rs
import Rhino.Geometry as rg
import Rhino
import math
import copy
import System
import ghpythonlib.treehelpers as th

tolerance = Rhino.RhinoDoc.ActiveDoc.ModelAbsoluteTolerance

length = 30
width = 15
height = 10

#GLOBAL function accessible to all classes
def remap(value,low1,high1, low2, high2):
    """
    value : original value
    low1 : original value's lower bound
    high1 : original value's upper bound
    low2 : remapped value's lower bound
    high2 : remapped value's upper bound
    """
    remapped_value = low2 + (value - low1) * (high2 - low2) / (high1 - low1)
    return remapped_value

class Brickwall(object):
    
    """
    this is a class to create a wall from a input curve and get the origin for its bricks
    
    """
    
    # this varible was defined outside of the class
    # we need to declare it as global so it will be shared by all instances of the class
    global height
    
    
    # this method gets calles as soon as the object of a class is initiated
    # here we define instance variables = attributes of the object
    def __init__(self, crv = None, srf = None , layer_cnt = None):
        
        self.layer_cnt = layer_cnt
        self.brick_cnt = None
        
        self.crv = crv
        self.srf = srf
        
        self.crvs = []
        self.bricks = [] #attribute which store bricks as a nested list of bricks
        
        if self.crv is not None:
            self.wall_from_curve(self.crv)
        elif self.srf is not None:
            self.wall_from_surface(srf)
        
    def get_layers(self, curve):
        
        crvs = []
        for i in range(self.layer_cnt):
            T = rg.Transform.Translation(rg.Vector3d(0,0,i*height))
            c = copy.copy(curve)
            c.Transform(T)
            crvs.append(c)
        return crvs
    
    def get_bricks(self):
        for i, c in enumerate(self.crvs):
            self.brick_cnt = math.floor(c.GetLength()/(length+5))
            params = c.DivideByCount(self.brick_cnt*2,True)
            pts = []
            tngts = []
            # list comprehension
            bricks_list = [] #stores bricks of one layer
            if i%2 == 0: # for every odd layer start list from 1 index
                params = params[1:] # [i:] list starts at i
            for j in range(len(params)): # goes through list params
                if j%2 == 0 : # for every next param
                    brick = Brick(c.PointAt(params[j]),c.TangentAt(params[j])) # single brick of type Brick class
                    bricks_list.append(brick) # add to brick layer
            #bricks = [Brick(c.PointAt(p),c.TangentAt(p)) for p in params[i%2::2]]  # FASTER WAY -Creating objects of type Brick class
            self.bricks.append(bricks_list) #add to wall
    
    def create_contours(self, srf, height):
        bounding_box = rg.Brep.GetBoundingBox(srf, rg.Plane.WorldXY) #get bounding box of surface
        num_layers =  int(math.ceil(bounding_box.Max.Z/height)) # divide by height of single brick
        inter_crvs = []
        for i in range(num_layers):
            origin = rg.Point3d(0,0,i*height)
            brep = srf.ToBrep()
            plane = rg.Plane(origin, rg.Vector3d.XAxis, rg.Vector3d.YAxis)
            
            intersection_event = rg.Intersect.Intersection.BrepPlane(brep,plane,tolerance)
            inter_crvs.append(intersection_event[1][0])
        return inter_crvs
    
    def wall_from_curve(self, curve):
        self.crvs = self.get_layers(curve)
        self.get_bricks()
    
    def wall_from_surface(self,srf):
        self.crvs = self.create_contours(srf, height)
        self.get_bricks()
    
    def get_attractor_distances(self, att_pt):
        all_distances = []
        for brick_layer in self.bricks:
            for brick in brick_layer:
                current_brickpt = brick.origin #attribute of brick class
                distance = att_pt.DistanceTo(brick.origin)
                if distance <200:
                    brick.att_dist = distance #attribute of class Brick
                    all_distances.append(distance)
        return all_distances
    
    def rotate_with_attractor(self,att_pt, max_angle = 45):
        dist_list = self.get_attractor_distances(att_pt)
        min_distance = 0
        max_distance = max(dist_list)
        #remap distances to angle for rotation
        for brick_layer in self.bricks:
            for brick in brick_layer:
                angle = remap(brick.att_dist, min_distance, max_distance, 0, math.radians(max_angle))
                brick_pln = brick.target_plane
#                rg.Plane.Rotate(brick_pln,angle,axis, point)
                brick_pln.Rotate(angle, brick_pln.ZAxis, brick_pln.Origin)


class Brick(object):
    
    """
    this is a class to make a brick
    """
    
    global length
    global width
    global height

    # this method gets calles as soon as the object of a class is initiated
    # here we define instance variables = attributes of the object
    def __init__(self, origin, vec):
        
        
        self.origin = origin 
        self.vec = vec # point's tangent vector

        
        self.pts = self.brick_pts()
        
        self.start_plane = self.get_start_plane()
        self.target_plane = self.get_target_plane()
        
        self.mesh = self.brick_mesh()
        self.neighbors= []
        self.color = []
        
        self.att_dist = 0
        
        
    # this method will be called in the __init__ function
    # it returns a list of 8 points of the bounding box 
    def brick_pts(self):
        
        pt_0 = rg.Point3d(self.origin.X-length/2, self.origin.Y-width/2, self.origin.Z)
        pt_1 = rg.Point3d(pt_0.X + length, pt_0.Y, self.origin.Z)
        pt_2 = rg.Point3d(pt_1.X, pt_1.Y + width, self.origin.Z)
        pt_3 = rg.Point3d(pt_2.X - length, pt_2.Y, self.origin.Z)

        pt_4 = rg.Point3d(pt_0.X, pt_0.Y, pt_0.Z + height)
        pt_5 = rg.Point3d(pt_1.X, pt_1.Y, pt_1.Z + height)
        pt_6 = rg.Point3d(pt_2.X, pt_2.Y, pt_2.Z + height)
        pt_7 = rg.Point3d(pt_3.X, pt_3.Y, pt_3.Z + height)

        b_pts = [pt_0, pt_1, pt_2, pt_3, pt_4, pt_5, pt_6, pt_7]

        return b_pts
    
    # this method is called in the __init__ function
    # it returns the start_plane of the brick accodring to boolean input
    def get_start_plane(self):
        
        yvec = rg.Vector3d.CrossProduct(rg.Vector3d(0,0,1), self.vec)
        start_plane = rg.Plane(self.origin, self.vec, yvec)
            
        return start_plane
    
    # this method is called in the __init__ function
    # it returns the rotated start plabe plane according to input value 
    def get_target_plane(self):
        c = copy.copy(self.start_plane)
        c.Rotate(math.radians(bricks_angle), rg.Vector3d.ZAxis, self.origin)
        return c
    
    # this method is called in the __init__ funciton
    # it creates the mesh from 8 points, transforms its plane and returns the mesh 
    def brick_mesh(self):
        br = rg.Mesh.CreateFromBox(self.pts,1,1,1)
        P = rg.Plane(self.origin, rg.Vector3d.XAxis, rg.Vector3d.YAxis)
        T1 = rg.Transform.PlaneToPlane(P, self.start_plane)
        T2 = rg.Transform.PlaneToPlane(self.start_plane, self.target_plane)
        br.Transform(T1)
        br.Transform(T2)
        
        return br

# calling the object
wall = Brickwall(crv = crv, srf = srf ,layer_cnt = layer_num) #instance of class BrickWall

print type(wall.bricks)

list = [[0,1,2],[3,4,5]]

all_bricks = wall.bricks

#first_list = wall.bricks[layer_index]
#selected = first_list[att_index]
selected = all_bricks[layer_index][att_index]
selected_mesh = selected.mesh
#selected_mesh = selected.brick_mesh()


attractor_pt = selected.origin
print attractor_pt

wall.rotate_with_attractor(attractor_pt,45)

bricks = [brick.brick_mesh() for brick_list in wall.bricks for brick in brick_list]
# ---------- end python ----------
pt = Point(flatten(python.pt_bricks))
crv_2 = Curve(python.crvs)
mesh = Mesh(python.bricks)
mesh_2 = Mesh(python.selected_mesh)
preview = CustomPreview(Geometry=mesh, Material=ColourSwatch(SwatchColor=RGB(99, 107, 255)))
